# Grasshopper definition Weights_Input.gh (Grasshopper 1.0.8)
# Copyright: HKS_2025

file_path = FilePath("C:\Users\krish\Downloads\ATN AEC Hackathon\Design Council\Output\weights_output.txt")
panel = Panel(file_path)
python_3_script = Python3Script(txt_path=panel)  # -> out, cost_gbp, carbon_eq, glazing_ratio
# ---------- python_3_script: Python ----------
import os

# Input: txt_path (str)
# Outputs: cost_gbp, carbon_eq, glazing_ratio, is_updated

if not txt_path or not os.path.exists(txt_path):
    cost_gbp      = 0.0
    carbon_eq     = 0.0
    glazing_ratio = 0.0
    is_updated    = False
else:
    weights = {}
    with open(txt_path, "r") as f:
        for line in f:
            line = line.strip()
            if "=" in line:
                key, val = line.split("=", 1)
                weights[key.strip()] = float(val.strip())

    cost_gbp      = weights.get("cost_gbp",      0.0)
    carbon_eq     = weights.get("carbon_eq",     0.0)
    glazing_ratio = weights.get("glazing_ratio", 0.0)
    is_updated    = True
# ---------- end python_3_script ----------
panel_2 = Panel([python_3_script.cost_gbp, python_3_script.carbon_eq, python_3_script.glazing_ratio])
